% Simulink data dictionary mcbEnumerations.sldd

mcbACIMParamTests = enum(DefaultValue="NoTest", StorageType="uint16")
  NoTest = 0
  Id0Test = 1
  RsTest = 2
  RrLTest = 3
  JBTest = 4

mcbPMSMParamTests = enum(DefaultValue="NoTest", StorageType="uint16")
  NoTest = 0
  RsTest = 1
  LdTest = 2
  LqTest = 3
  KeJBTest = 4
  Error = 99